# Grasshopper definition plugin_tests.gh (Grasshopper 1.0.8)
# plug-ins: CRFT Tools

webcam = Webcam(Enable=Toggle(False), Device=Slider(0, range=0..1), Name="webcam")  # -> Image, RecordingPath
panel = Panel("/private/tmp/frames_webcam_20250419_180845/webcam_20250419_181142.mp4")
panel_2 = Panel(webcam.RecordingPath)
boolean_toggle = BooleanToggle(True)
sam_ui = SAMUI(VideoPath=panel_2, FrameRate=Slider(1, range=0..1), Run=False, Preserve=Toggle(True))  # -> Status, OutputPath, Points
ply_importer = PLYImporter(Import=True)  # -> Mesh, Vertices, Colors
